# Grasshopper definition Weibull-Rhino8.ghx (Grasshopper 1.0.8)
# plug-ins: RhinoCodePluginGH

py3 = Python3Script()  # -> out, rhino_file_path
# ---------- py3: Python ----------
from Rhino import RhinoDoc

rhino_file_path = RhinoDoc.ActiveDoc.Path
# ---------- end py3 ----------
panel = Panel("/Users/patrickkastner/Documents/GitHub/VIP-SMUR/pedestrian-wind-comfort-weibull/wdir.csv")
panel_2 = Panel("/Users/patrickkastner/Documents/GitHub/VIP-SMUR/pedestrian-wind-comfort-weibull/ws.csv")
panel_3 = Panel(py3.rhino_file_path)
py3_2 = Python3Script(ws_path=panel_2, wdir_path=panel)  # -> out, a
# ---------- py3_2: Python ----------
"""Grasshopper Script"""
# requirements: scipy
# requirements: numpy
# requirements: numpy
# requirements: pandas
# requirements: matplotlib
from scipy import stats
import numpy as np
import pandas as pd
import matplotlib.pyplot as plt
import math


print( """Attempt to fit with weibull_min.fit, MATCHES C# library""")

# c : array_like

# shape parameters

# loc : array_like, optional

# location parameter (default=0)

# scale : array_like, optional

# scale parameter (default=1)

#https://stackoverflow.com/questions/17481672/fitting-a-weibull-distribution-using-scipy""")




#Kappa_in = 1.8 # shape
#Lambda_in = 10 # scale


np.seterr(divide='ignore', invalid='ignore')

df_ws = pd.read_csv(ws_path, header=None)
df_wdir = pd.read_csv(wdir_path, header=None)

data = pd.concat([df_ws, df_wdir], axis=1)
data.columns = ['ws', 'wdir']



def fit_and_plot2(column):

    #The a and loc are fixed in the fit since it is standard to assume they are known
    Kappa_out, loc_out,  Lambda_out = stats.weibull_min.fit(column)

    #Plot

    bins_hist = np.linspace(0, 20, 21)
    bins_cont = np.linspace(0, 20, 81)


    fig = plt.figure()
    ax = fig.add_subplot(1, 1, 1)
    ax.plot(bins_cont, stats.weibull_min.pdf(bins_cont,c=Kappa_out,loc=loc_out,scale = Lambda_out))
    ax.hist(column, bins = bins_hist , density=True, alpha=0.5)
    ax.annotate("Shape: $k = %.2f$ \n Scale: $\lambda = %.2f$"%(Kappa_out,Lambda_out), xy=(0.7, 0.85), xycoords=ax.transAxes)

    def prob_exceedance(a_theta, u, k, c):
        # not in percentage
        # c = lambda
        return a_theta * math.exp(-(u / c) ** k)

    # https://www.desmos.com/calculator/q5j5jhhit0

    def a_theta(wind_dir, arr):
        return len(np.where((arr < wind_dir + 15) | (arr > wind_dir - 15 + 360))[0]) / len(arr)


    velocity = 2

    pe = prob_exceedance(1, velocity, Kappa_out, Lambda_out)
    print("Probability of Exceedance for", velocity, "m/s: ",  pe)

    ex_manual = []
    for i in bins_cont:
        ex_manual.append(prob_exceedance(1, i, Kappa_out, Lambda_out))

    ax2 = ax.twinx()  # instantiate a second axes that shares the same x-axis
    ax2.plot(bins_cont, ex_manual, 'r')
    ax.set_ylabel("Density")
    ax2.set_ylabel("POE")
    ax.set_xlabel("Wind velocity [m/s]")
    plt.show()

fit_and_plot2(data['ws'])
# ---------- end py3_2 ----------
panel_4 = Panel([py3_2.out, py3_2.a])
