# Grasshopper definition weibull.gh (Grasshopper 1.0.7)
# plug-ins: Archsim

# Real EPW
panel = Panel("C:\Users\pkastner\Google Drive\Patrick\Papers\CPGenerator\Conference\Data\Weather\USA_NY_Syracuse-Hancock.Intl.AP.725190_TMY3.epw")
# Test wind file
panel_2 = Panel("C:\Users\pkastner\Documents\GitHub\wind_comfort_weibull\ws.csv")
file = ReadFile(File=panel_2, PerLineParse=True)
panel_3 = Panel("""4
6
8""")
number_slider = Slider(4, range=0..10)
weather = Weather(
    Location=panel,
    Input_0_Hidden=False,
    Input_0_Name="Location",
    Output_0_Hidden=True,
    Output_0_Name="Location",
    Output_10_Hidden=True,
    Output_10_Name="DiffuseHorizontalRadiation",
    Output_11_Hidden=True,
    Output_11_Name="GlobalHorizontalRadiation",
    Output_12_Hidden=True,
    Output_12_Name="SkyCover",
    Output_13_Hidden=True,
    Output_13_Name="Precipitation",
    Output_14_Hidden=True,
    Output_14_Name="Elev",
    Output_15_Hidden=True,
    Output_15_Name="Azimuth",
    Output_16_Hidden=True,
    Output_16_Name="Vector",
    Output_17_Hidden=True,
    Output_17_Name="Illuminance",
    Output_18_Hidden=True,
    Output_18_Name="DateTime",
    Output_19_Hidden=True,
    Output_19_Name="DryBulbAverages",
    Output_1_Hidden=True,
    Output_1_Name="Latitude",
    Output_20_Hidden=True,
    Output_20_Name="DewPointAverages",
    Output_21_Hidden=True,
    Output_21_Name="DryBulbMinima"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)  # -> WindSpeed, WindDirection
c_script = CSharpScript(ws=weather.WindSpeed, Reference="C:\Users\pkastner\Documents\GitHub\Eddy3d\Eddy\bin\MathNet.Numerics.dll")  # -> out, est, Kappa, Lambda; inputs ws: list of Double
# ---------- c_script: C# usings ----------
using MathNet.Numerics.Distributions;
using System.Linq;
# ---------- c_script: C# ----------
    var estimated = Weibull.Estimate(ws);


    //wb_new = wb;
    est = estimated;
    var wb = new Weibull(estimated.Shape, estimated.Scale);

    Kappa = wb.Shape;
    Lambda = wb.Scale;
# ---------- end c_script ----------
c_script_2 = CSharpScript(ws=file, Reference="C:\Users\pkastner\Documents\GitHub\Eddy3d\Eddy\bin\MathNet.Numerics.dll")  # -> out, est, Kappa, Lambda; inputs ws: list of Double
# ---------- c_script_2: C# ----------
    var estimated = Weibull.Estimate(ws);

   
 //wb_new = wb;
    est = estimated;
     var wb = new Weibull(estimated.Shape, estimated.Scale);
    
    Kappa = wb.Shape;
    Lambda = wb.Scale;
# ---------- end c_script_2 ----------
panel_4 = Panel(c_script_2.Lambda)
panel_5 = Panel(c_script_2.Kappa)
c_script_3 = CSharpScript(a_theta=Slider(1, range=0..1), u=Slider(0, range=0..10), k=panel_5, c=panel_4)  # -> out, P_Upot_Utr10m; inputs a_theta: Double, u: Double, k: Double, c: Double
# ---------- c_script_3: C# ----------
    P_Upot_Utr10m = Prob_Exceedance(a_theta, u, k, c);
# ---------- c_script_3: C# additional code ----------
  public static double Prob_Exceedance(double a_theta, double u, double k, double c){
    // not in percentage
    // c = lambda
    //return a_theta * Math.Exp(Math.Pow(-(u / c), k));
    return a_theta * Math.Exp(-Math.Pow((u / c),k));
  }
# ---------- end c_script_3 ----------
bar_graph = BarGraph(file, BarColor=RGB(255, 0, 90))
c_script_4 = CSharpScript(WDir=weather.WindDirection, WSp=weather.WindSpeed)  # -> out, IL, RES; inputs WDir: list of Int32, WSp: list of Double
# ---------- c_script_4: C# usings ----------
using System.Linq;
# ---------- c_script_4: C# ----------
    List<int> IndexList = WDir.Select((value, index) => new { value, index = index})
      .Where(pair => Match(pair.value, 10))
      .Select(pair => pair.index).ToList();
    
    
    var res = WSp.Where((item, index) => IndexList.Contains(index)).ToList();
      
    IL = IndexList;
    RES = res;
# ---------- c_script_4: C# additional code ----------
  
  
  public static bool Match (int input, int compare_to){     

    return input == compare_to;
  }
# ---------- end c_script_4 ----------
c_script_5 = CSharpScript(
    WDir=weather.WindDirection,
    WSp=weather.WindSpeed,
    u=panel_3,
    Reference="C:\Users\pkastner\Documents\GitHub\Eddy3d\Eddy\bin\MathNet.Numerics.dll")  # -> out, IL, RES, P; inputs WDir: list of Int32, WSp: list of Double, u: Double
# ---------- c_script_5: C# usings ----------
using System.Linq;
using MathNet.Numerics.Distributions;
# ---------- c_script_5: C# ----------
    var UniqueWindDirs = new HashSet<int>(WDir);

    double P = 0.0;


    var PY = new List<double>();


    foreach(int dir in UniqueWindDirs){

      // Select the WSp based on the indexes of constant wind directions for every unique wind direction

      List<int> IndexList = WDir.Select((value, index) => new { value, index = index})
        .Where(pair => Match(pair.value, dir))
        .Select(pair => pair.index).ToList();

      var res = WSp.Where((item, index) => IndexList.Contains(index)).ToList();


      // Weibull estimate

      var estimated = Weibull.Estimate(res);
      //var wb = new Weibull(estimated.Shape, estimated.Scale);
      var Kappa = estimated.Shape;
      var Lambda = estimated.Scale;


      int ConstantHoursPerYear = WDir.Select((value, index) => new { value, index = index})
        .Where(pair => Match(pair.value, dir))
        .Select(pair => pair.index).Count();

      double PercentagePerYear = (double) ConstantHoursPerYear / 8760;

      double P_Upot_Utr10m = Prob_Exceedance(PercentagePerYear, u, Kappa, Lambda);

      PY.Add(P_Upot_Utr10m);

      P += P_Upot_Utr10m;


    }




    IL = UniqueWindDirs;
    RES = PY;
    P_ = P;
# ---------- c_script_5: C# additional code ----------
  public static bool Match (int input, int compare_to){

    return input == compare_to;
  }

  public static double Prob_Exceedance(double a_theta, double u, double k, double c){
    // not in percentage
    // c = lambda
    return a_theta * Math.Exp(-Math.Pow((u / c), k));
  }
# ---------- end c_script_5 ----------
c_script_6 = CSharpScript(WDir=weather.WindDirection, WSp=weather.WindSpeed)  # -> out, IL, RES; inputs WDir: list of Int32, WSp: list of Double
# ---------- c_script_6: C# ----------
    var UniqueWindDirs = new HashSet<int>(WDir);

    
    var PY = new List<double>();
    
    
    foreach(int dir in UniqueWindDirs){
      
      int PercentageOfYear = WDir.Select((value, index) => new { value, index = index})
        .Where(pair => Match(pair.value, dir))
        .Select(pair => pair.index).Count();
      
      Print(((double)PercentageOfYear ).ToString());
      
      PY.Add((double)PercentageOfYear/ 8760 );
      
      
    }
    
    
    
    
    IL = UniqueWindDirs;
    RES = PY;
# ---------- c_script_6: C# additional code ----------
  public static bool Match (int input, int compare_to){

    return input == compare_to;
  }
# ---------- end c_script_6 ----------
panel_6 = Panel(c_script_2.est)
panel_7 = Panel(c_script.est)
panel_8 = Panel(c_script_5.P)
panel_9 = Panel(c_script_3.P_Upot_Utr10m)
panel_10 = Panel(c_script_4.RES)
panel_11 = Panel(c_script_4.IL)
panel_12 = Panel(c_script_6.IL)
panel_13 = Panel(c_script_6.RES)
